# Grasshopper definition waffle_test.gh (Grasshopper 1.0.7)

surface_height = Slider(50, range=10..1000)
surface_size = Slider(180, range=0..1000)
resolution = Slider(6, range=0..20)

waffle_division = Slider(5, range=0..100)
leg_number = Slider(4, range=0..10)
leg_height = Slider(50, range=0..1000)

# ---- group: 複雑な曲面を作る
num = Number(surface_size)
num_2 = Number(resolution)
planesrf = PlaneSurface(Plane=PlaneXY(0, 0, 0), XSize=num, YSize=num)
sdivide = DivideSurface(Surface=planesrf, UCount=num_2, VCount=num_2)  # -> Points, Normals, Parameters
flatten = FlattenTree(Tree=sdivide.Points, Path="{0}")
num_3 = Number(surface_height)

# ----
# Component Parameter
梁せい = Slider(12, range=0..1000)
wood_thickness = Slider(3, range=0..10)

# ---- group: 複雑な曲面を作る / Randomに抽出
seed = Slider(816, range=0..1000)
lng = ListLength(List=flatten)
random = Random(Range=lng, Number=leg_number, Seed=seed)
item = ListItem(List=flatten, Index=random, Wrap=True)

# ---- group: 複雑な曲面を作る / 点xと各点との距離をはかり、300以下にする
graft = GraftTree(Tree=item, IncludeEmptyLists=True, IncludeNullItems=True)
dist = Distance(PointA=graft, PointB=flatten)
min = Minimum(A=dist, B=Slider(50, range=0..1000))

# ----
num_4 = Number(waffle_division)
num_5 = Number(leg_height)

# ---- group: 複雑な曲面を作る / 0-leglheightの間に標準化
flatten_2 = FlattenTree(Tree=min, Path="{0}")
bnd = Bounds(Numbers=flatten_2)
dom = ConstructDomain(DomainStart=num_5, DomainEnd="0")
panel = Panel(dom)
remap = RemapNumbers(Value=min, Source=bnd, Target=dom)  # -> Mapped, Clipped
panel_2 = Panel(remap.Mapped)

# ---- group: 複雑な曲面を作る / Z軸方向に移動
flip = FlipMatrix(Data=remap.Mapped)
ma = MassAddition(Input=flip)  # -> Result, PartialResults
Z = UnitZ(Factor=ma.Result)
flatten_3 = FlattenTree(Tree=Z, Path="{0}")
move = Move(Geometry=flatten, Motion=flatten_3)  # -> Geometry, Transform

# ---- group: 複雑な曲面を作る / 移動した点と移動する前の点でSRFを作成
num_6 = Number(resolution)
Z_2 = UnitZ(Factor=num_3)
addition = Addition(A=num_6, B="1")
move_2 = Move(Geometry=planesrf, Motion=Z_2)  # -> Geometry, Transform
srfgrid = SurfaceFromPoints(Points=move.Geometry, UCount=addition, Interpolate=False)

# ----
# Create Grid
srf = Surface(srfgrid)
preview = CustomPreview(Geometry=srf, Material=ColourSwatch(SwatchColor=RGB(87, 199, 255)))

bbox = BoundingBox(Content=srf, Plane=PlaneXY(0, 0, 0))  # -> Box, Box_2
box_corners = BoxCorners(Box=bbox.Box)  # -> CornerA, CornerB, CornerC, CornerD, CornerE, CornerF, CornerG, CornerH
points = PointList(
    Points=[box_corners.CornerB, box_corners.CornerA, box_corners.CornerC, box_corners.CornerD],
    Size=Slider(10, range=0..10))
num_7 = Number(waffle_division)
ln = Line(StartPoint=box_corners.CornerC, EndPoint=box_corners.CornerB)
ln_2 = Line(StartPoint=box_corners.CornerC, EndPoint=box_corners.CornerD)
ln_3 = Line(StartPoint=box_corners.CornerD, EndPoint=box_corners.CornerA)
ln_4 = Line(StartPoint=box_corners.CornerB, EndPoint=box_corners.CornerA)
divide = DivideCurve(Curve=ln_4, Count=num_7, Kinks=False)  # -> Points, Tangents, Parameters
divide_2 = DivideCurve(Curve=ln, Count=num_7, Kinks=False)  # -> Points, Tangents, Parameters
divide_3 = DivideCurve(Curve=ln_2, Count=num_7, Kinks=False)  # -> Points, Tangents, Parameters
divide_4 = DivideCurve(Curve=ln_3, Count=num_7, Kinks=False)  # -> Points, Tangents, Parameters
ln_5 = Line(StartPoint=divide.Points, EndPoint=divide_3.Points)
ln_6 = Line(StartPoint=divide_2.Points, EndPoint=divide_4.Points)

# ---- group: 曲面との交差する曲線を求めるためのbox下端
Z_3 = UnitZ(Factor="1")
Z_4 = UnitZ(Factor="1")
neg = Negative(Value=Z_3)
neg_2 = Negative(Value=Z_4)
move_3 = Move(Geometry=ln_5, Motion=neg)  # -> Geometry, Transform
move_4 = Move(Geometry=ln_6, Motion=neg_2)  # -> Geometry, Transform

# ----
# 高さを大きめに設定することで、曲面がすべて入るようにする
panel_3 = Panel("10")

# ----
# 面を取り出す
merge = Merge()
brep = Brep(merge)
debrep = DeconstructBrep(Brep=brep)  # -> Faces, Edges, Vertices
area = Area(Geometry=debrep.Faces)  # -> Area, Centroid
sort = SortList(Keys=area.Area, ValuesA=debrep.Faces)  # -> Keys, ValuesA
rev = ReverseList(List=sort.ValuesA)
subset = SubList(List=rev, Domain="1", Wrap=True)  # -> List, Index

neg_3 = Negative(Value="100")
pt = ConstructPoint(XCoordinate=neg_3, YCoordinate=neg_3, ZCoordinate=0)
area_2 = Area(Geometry=subset.List)  # -> Area, Centroid
dist_2 = Distance(PointA=area_2.Centroid, PointB=pt)
sort_2 = SortList(Keys=dist_2, ValuesA=subset.List)  # -> Keys, ValuesA
item_2 = ListItem(List=sort_2.ValuesA, Index=0, Wrap=True)

simplify = SimplifyTree(Tree=item_2, Front=False)
pshift = ShiftPaths(Data=simplify, Offset=-1)
pt_2 = ConstructPoint(XCoordinate="0.5", YCoordinate="0.5", ZCoordinate=0)
srf_2 = Surface(reparameterize(pshift))
evalsrf = EvaluateSurface(Surface=srf_2, Point=pt_2)  # -> Point, Normal, UDirection, VDirection, Frame

crv = Curve(pshift)
flip_2 = FlipMatrix(Data=crv)
tstat = TreeStatistics(Tree=crv)  # -> Paths, Length, Count
tstat_2 = TreeStatistics(Tree=flip_2)  # -> Paths, Length, Count
lng_2 = ListLength(List=tstat_2.Paths)
lng_3 = ListLength(List=tstat.Paths)
series = Series(Start=Slider(1952, range=0..10000), Step=Slider(719, range=0..1000), Count=lng_3)
series_2 = Series(Start=Slider(18, range=0..100), Step=Slider(1310, range=0..10000), Count=lng_2)

series_3 = Series(Start=0, Step=1, Count=10)
graft_2 = GraftTree(Tree=series, IncludeEmptyLists=True, IncludeNullItems=True)
pt_3 = ConstructPoint(XCoordinate=graft_2, YCoordinate=series_2, ZCoordinate=0)
xy = XYPlane(Origin=pt_3)
orient = Orient(Geometry=crv, Source=evalsrf.Frame, Target=xy)  # -> Geometry, Transform

Z_5 = UnitZ(Factor=梁せい)
# Extrusion
Z_6 = UnitZ(Factor=梁せい)
Y = UnitY(Factor=wood_thickness)
X = UnitX(Factor=wood_thickness)
Y_2 = UnitY(Factor=wood_thickness)
X_2 = UnitX(Factor=wood_thickness)

# ----
# Project Grid on Srf.
dist_3 = Distance(PointA=box_corners.CornerA, PointB=box_corners.CornerE)

addition_2 = Addition(A=dist_3, B=panel_3)

Z_7 = UnitZ(Factor=addition_2)
extr = Extrude(Base=move_4.Geometry, Direction=Z_7)
extr_2 = Extrude(Base=move_3.Geometry, Direction=Z_7)
bbx = BrepBrep(BrepA=extr_2, BrepB=srf)  # -> Curves, Points
bbx_2 = BrepBrep(BrepA=extr, BrepB=srf)  # -> Curves, Points

extr_3 = Extrude(Base=bbx.Curves, Direction=Z_5)
extr_4 = Extrude(Base=bbx_2.Curves, Direction=Z_6)
move_5 = Move(Geometry=extr_4, Motion=expr("-x/2", Y))  # -> Geometry, Transform
move_6 = Move(Geometry=extr_3, Motion=expr("-x/2", X))  # -> Geometry, Transform
extr_5 = Extrude(Base=move_5.Geometry, Direction=Y_2)
extr_6 = Extrude(Base=move_6.Geometry, Direction=X_2)

crv_2 = Curve(bbx_2.Curves)
crv_3 = Curve(bbx.Curves)

# ----
# Creating joints
ccx = CurveCurve(CurveA=flatten(crv_3), CurveB=crv_2)  # -> Points, ParamsA, ParamsB
box = CenterBox(Base=ccx.Points, X=expr("x/2", wood_thickness), Y=expr("x/2", wood_thickness), Z=expr("x/2", 梁せい))
Z_8 = UnitZ(Factor=梁せい)
move_7 = Move(Geometry=box, Motion=flatten(Z_8))  # -> flatten(Geometry), Transform
geo = Geometry(flatten(box))
sdiff = SolidDifference(BrepsA=extr_6, BrepsB=geo)
sdiff_2 = SolidDifference(BrepsA=extr_5, BrepsB=move_7.Geometry)
preview_2 = CustomPreview(Geometry=[sdiff, sdiff_2], Material=ColourSwatch(SwatchColor=RGB(102, 87, 117)))
preview_3 = CustomPreview(Geometry=sdiff_2, Material=ColourSwatch(SwatchColor=RGB(186, 153, 61)))

number_slider = Slider(0, range=0..1000)
number_slider_2 = Slider(44, range=0..1000)
# Fabrication
panel_4 = Panel("1")
addition_3 = Addition(A=num_4, B=panel_4)
series_4 = Series(Start=number_slider, Step=number_slider_2, Count=addition_3)
series_5 = Series(Start=number_slider, Step=number_slider_2, Count=addition_3)
Y_3 = UnitY(Factor=series_4)
Y_4 = UnitY(Factor=series_5)
pt_4 = Point(Point(291.8812437, 0.3566332175, 0))
pt_5 = Point(Point(500, 0, 0))
move_8 = Move(Geometry=pt_4, Motion=Y_3)  # -> Geometry, Transform
move_9 = Move(Geometry=pt_5, Motion=Y_4)  # -> Geometry, Transform
number_slider_3 = Slider(31, range=0..100)
sec = BrepPlane(Brep=sdiff, Plane=graft(extr_2))  # -> flatten(Curves), Points
sec_2 = BrepPlane(Brep=sdiff_2, Plane=graft(extr))  # -> flatten(Curves), Points
points_2 = PointList(Points=move_8.Geometry, Size=number_slider_3)
points_3 = PointList(Points=move_9.Geometry, Size=number_slider_3)
crv_4 = Curve(sec.Curves)
crv_5 = Curve(sec_2.Curves)
orient_2 = Orient(Geometry=crv_4, Source=extr_2, Target=move_8.Geometry)  # -> Geometry, Transform
orient_3 = Orient(Geometry=crv_5, Source=extr, Target=move_9.Geometry)  # -> Geometry, Transform
